# Grasshopper definition agent-based-reef.gh (Grasshopper 1.0.8)
# plug-ins: RhinoCodePluginGH

hexagon_reef = Geometry(<brep referenced from the Rhino model>)
square_reef = Geometry(<extrusion referenced from the Rhino model>)
srf = Surface(<surface referenced from the Rhino model>)
srf_2 = Surface(<surface referenced from the Rhino model>)
mesh = Mesh(<mesh referenced from the Rhino model>)
popgeo = PopulateGeometry(Geometry=mesh, Count=100, Seed=1)
walker_agent = Python3Script(surface=srf, seed=Slider(10, range=0..10), time=Slider(1000, range=0..1000))  # -> out, a; inputs surface: Surface, seed: Int32, time: Int32
# ---------- walker_agent: Python ----------
import rhinoscriptsyntax as rs
import random as r

# Set the random seed for reproducibility
r.seed(seed)

# Define the Walker class
class Walker:

    def __init__(self, surface):
        # Initialize the surface and position of the walker
        self.surface = surface
        u_domain = rs.SurfaceDomain(surface, 0)
        v_domain = rs.SurfaceDomain(surface, 1)
        # Start at the center of the surface
        self.u = (u_domain[0] + u_domain[1]) / 2
        self.v = (v_domain[0] + v_domain[1]) / 2

    def step(self):
        # Randomly adjust the u and v parameters within the surface domain
        u_domain = rs.SurfaceDomain(self.surface, 0)
        v_domain = rs.SurfaceDomain(self.surface, 1)
        
        du = r.uniform(-5, 5)  # Small random step in u
        dv = r.uniform(-5, 5)  # Small random step in v

        # Update the position while ensuring it stays within the surface domain
        self.u = max(min(self.u + du, u_domain[1]), u_domain[0])
        self.v = max(min(self.v + dv, v_domain[1]), v_domain[0])

    @property
    def point(self):
        # Evaluate the surface at the current u and v parameters to get the 3D point
        return rs.EvaluateSurface(self.surface, self.u, self.v)

# Create a walker instance starting on the input surface
w = Walker(surface)

# List to store points
pList = []

# Iterate for the given number of time steps
for t in range(time):
    w.step()  # Update the walker's position
    pList.append(w.point)  # Add the current position to the list

# Output the list of points
a = [rs.AddPoint(p) for p in pList]  # Visualize points in Rhino
# ---------- end walker_agent ----------
random = Random(Range=Domain(0, 1), Number=1, Seed=popgeo)  # -> flatten(Random)
pt = Point(walker_agent.a)
sph = Sphere(Base=popgeo, Radius=random)
scale = Scale(Geometry=popgeo, Center=Point(0, 0, 0), Factor=Slider(0.95, range=0..1))  # -> Geometry, Transform
sdiff = SolidDifference(BrepsA=square_reef, BrepsB=sph)
point_gradual_translation = Python3Script(points=pt, start_z=Slider(1, range=0..10), end_z=Slider(41, range=0..100))  # -> out, a; inputs start_z: Int32, end_z: Int32
# ---------- point_gradual_translation: Python ----------
import rhinoscriptsyntax as rs

# Inputs:
# points: A single point or a list of points
# start_z: Z-axis translation for the last point in the list
# end_z: Z-axis translation for the first point in the list

# Ensure points is a list
if not isinstance(points, list):
    points = [points]

# Convert GUIDs to actual point coordinates
actual_points = [rs.coerce3dpoint(pt) for pt in points]
if not all(actual_points):
    raise ValueError("Some inputs are not valid points.")

# Number of points
n_points = len(actual_points)

# Create the translated points list
translated_points = []

if n_points > 1:  # Ensure there are enough points to interpolate
    for i, pt in enumerate(actual_points):
        # Compute proportional Z translation
        t = i / (n_points - 1)  # Normalized interpolation factor (0 to 1)
        z_translation = (1 - t) * start_z + t * end_z  # Linear interpolation
        
        # Translate the point
        new_point = rs.PointAdd(pt, [0, 0, -z_translation])
        translated_points.append(new_point)
elif n_points == 1:  # Handle the case of a single point
    # Translate the single point by the average of start_z and end_z
    z_translation = (start_z + end_z) / 2
    new_point = rs.PointAdd(actual_points[0], [0, 0, -z_translation])
    translated_points.append(new_point)

# Output the translated points
a = translated_points
# ---------- end point_gradual_translation ----------
brep = Brep(<brep referenced from the Rhino model>)
pt_2 = Point(point_gradual_translation.a)
porosity_generator = Python3Script(input_geometry=brep, input_points=scale.Geometry)  # -> out, modified_mesh
# ---------- porosity_generator: Python ----------
# requirements: numpy, scipy
import Rhino.Geometry as rg
import rhinoscriptsyntax as rs
import random

# Define the Agent class
class PorosityAgent:
    def __init__(self, position, radius):
        """
        Initializes the agent.

        Parameters:
        - position: A Rhino.Geometry.Point3d representing the agent's position.
        - radius: The radius of the spherical void created by the agent.
        """
        self.position = position
        self.radius = radius

    def create_void(self):
        """
        Creates a spherical void at the agent's position.

        Returns:
        - A Rhino.Geometry.Sphere.
        """
        return rg.Sphere(self.position, self.radius)

# Function to apply porosity to the geometry
def apply_porosity(input_geometry, points):
    """
    Applies porosity to the given geometry by subtracting spherical voids.

    Parameters:
    - input_geometry: The base Rhino.Geometry.Brep.
    - points: A list of Rhino.Geometry.Point3d defining the void locations.

    Returns:
    - A new Rhino.Geometry.Brep with porosity applied.
    """
    if not isinstance(input_geometry, rg.Brep):
        raise ValueError("Input geometry must be a Brep.")

    # Create a copy of the input geometry to modify
    modified_geometry = input_geometry.DuplicateBrep()

    # Create a list to hold the spherical voids
    voids = []

    # Create agents for each point and generate voids
    for point in points:
        radius = random.uniform(1, 5)  # Random radius between 1 and 5
        agent = PorosityAgent(point, radius)
        voids.append(agent.create_void())

    # Convert spheres to Breps and subtract them from the geometry
    void_breps = [sphere.ToBrep() for sphere in voids]
    for void_brep in void_breps:
        boolean_result = rg.Brep.CreateBooleanDifference([modified_geometry], [void_brep], 0.01)
        if boolean_result:
            modified_geometry = boolean_result[0]

    return modified_geometry

# Grasshopper inputs
# input_geometry: The base geometry (Brep) from Grasshopper
# input_points: A list of points (Point3d) from Grasshopper
if 'input_geometry' in globals() and 'input_points' in globals():
    try:
        # Run the porosity function
        output_geometry = apply_porosity(input_geometry, input_points)
    except Exception as e:
        output_geometry = None
        print(f"Error: {e}")
else:
    output_geometry = None
    print("Error: Ensure 'input_geometry' and 'input_points' are connected in Grasshopper.")
# ---------- end porosity_generator ----------
mesh_generator = Python3Script(input_brep=brep)  # -> out, a
# ---------- mesh_generator: Python ----------
import Rhino.Geometry as rg

def brep_to_mesh(input_brep):
    """
    Convert a Brep (solid or surface) into a Mesh.
    
    Parameters:
    - input_brep: A Rhino Brep object to be converted into a Mesh.
    
    Returns:
    - A Rhino Mesh object created from the input Brep.
    """
    # Ensure the input is a valid Brep
    if not isinstance(input_brep, rg.Brep):
        raise ValueError("Input geometry must be a Brep.")
    
    # Convert Brep to Mesh
    mesh_list = rg.Mesh.CreateFromBrep(input_brep)
    
    # If mesh creation was successful, return the first mesh (in case of multiple)
    if mesh_list and len(mesh_list) > 0:
        return mesh_list[0]
    else:
        raise ValueError("Mesh creation from Brep failed.")
# ---------- end mesh_generator ----------
mesh_2 = Mesh(mesh_generator.a)
mesh_3 = Mesh(porosity_generator.modified_mesh)
